# Grasshopper definition skinPattern.ghx (Grasshopper 1.0.7)
# plug-ins: ScriptParasite

curve = Curve(<curve referenced from the Rhino model>)

ghpython_script = GhPythonScript(file_name="skinPattern\skinPattern.py")  # -> path
# ---------- ghpython_script: Python ----------
a = ghdoc.Path

path = a.split('3d_printing_teamwork')[0]+r'3d_printing_teamwork\\'+file_name
# ---------- end ghpython_script ----------
read_file = ReadFile(File=ghpython_script, PerLineParse=False)

curve_2 = Curve(<curve referenced from the Rhino model>)
divide_curve = DivideCurve(Curve=curve_2, Count=20, Kinks=False)  # -> Points, Tangents, Parameters
button = Button()
timer = Timer(Interval=50, TimerInterval=50, Target=c_script)  # disabled

c_script = CSharpScript(
    zPoints=divide_curve.Points,
    zReset=button,
    zRadius="2",
    zEdge=curve,
    zMaxCounts="1000",
    FilletRatio=Slider(0.25, range=0..1))  # -> out, zOutTemp; inputs zPoints: list of Point3d, zReset: Boolean, zRadius: Double, zEdge: Curve, zMaxCounts: Int32, FilletRatio: Double
# ---------- c_script: C# ----------
    if (zReset)
    { zInteration = 0; }
    zInteration++;
    List<Circle> circles = new List<Circle>();
    List<Point3d> OutPoint = new List<Point3d>();
    for (int iteration = 0; iteration < zInteration; iteration++)
    {
      List<Vector3d> totalVector = new List<Vector3d>();
      List<double> counts = new List<double>();
      for (int i = 0; i < zPoints.Count; i++)
      {
        totalVector.Add(new Vector3d(0, 0, 0));
        counts.Add(0);
      }
      for (int i = 0; i < zPoints.Count; i++)
        for (int j = i + 1; j < zPoints.Count; j++)
        {
          double distance = zPoints[i].DistanceTo(zPoints[j]);
          if (2 * zRadius < distance) continue;
          else
          {

            Vector3d subVector = zPoints[i] - zPoints[j];
            subVector.Unitize();
            subVector *= 0.5 * (2 * zRadius - distance);
            totalVector[i] += subVector;
            totalVector[j] -= subVector;
            counts[i] += 1;
            counts[j] += 1;

          }
        }
      for (int k = 0; k < zPoints.Count; k++)
        if (counts[k] != 0)
        {
          if (zEdge.Contains(zPoints[k]) == PointContainment.Inside)
          {
            Vector3d move = totalVector[k] / counts[k];
            zPoints[k] += move;
          }

        }
      if (zPoints.Count < zMaxCounts)
      {
        List<int> Indices = new List<int>();

        for (int i = 0; i < zPoints.Count - 1; i++)
        {
          if (zPoints[i].DistanceTo(zPoints[i + 1]) > zRadius)
          { Indices.Add(i + 1 + Indices.Count); }
        }
        foreach (int Index in Indices)
        {
          Point3d addPoint = 0.5 * (zPoints[Index - 1] + zPoints[Index]);
          zPoints.Insert(Index, addPoint);
        }
      }
    }

    // foreach (Point3d point in zPoints)
    // {
    //     OutPoint.Add(point);
    // }
    // zOutPoints = OutPoint;



    for (int i = 1; i < zPoints.Count - 1; i++)
    {
            Point3d po = new Point3d(zPo)
    }
# ---------- c_script: C# additional code ----------
  int zInteration = 0;
# ---------- end c_script ----------
script_parasite = ScriptParasite(Enable=Toggle(True), Folder="C:\Zac\GitHub\3d_printing_teamwork\skinPattern\csharp")

ghpython_script_2 = GhPythonScript(Code=read_file, Points=divide_curve.Points, Reset=button, Radius="2", Edge=curve, MaxCounts="1000")  # -> Out, OutPoints
panel = Panel(ghpython_script_2.Out)

panel_2 = Panel(c_script.out)
polyline = PolyLine(Vertices=c_script.zOutTemp, Closed=False)
